% Simulink data dictionary Aerodynamic_data.sldd
% references Environment_data.sldd
% references Main_data.sldd

Flight_mechanics_bus = Simulink.Bus()
  Force_vector: double[3]
  Moment_vector: double[3]

a_coef_body = [0.2 0 0 0 0 0]
a_cg = [0 0 0]
a_cp = [0 0 0]
a_surface_ref = 0.03141593
a_span_ref = 0
a_length_ref = 0.5