% Simulink data dictionary Environment_data.sldd
% references Dynamic_data.sldd

Earth_mu = 398600000000000

Environment_bus = Simulink.Bus()
  Relative_velocity: double[3]
  Temperature: double
  Sound_speed: double
  Mach: double
  Pressure: double
  Dynamic_pressure: double
  Density: double
  Gravity_constant: double

Earth_radius = 6374140
e_vel_wind = 0
e_theta_wind = 90