% Simulink data dictionary Seeker_detect_data.sldd
% references Designator_Sim_data.sldd
% references Ray_tracing_hit_data.sldd
% references Target_Sim_data.sldd

Impact_Seeker_Bus = Simulink.Bus()
  Impact_Seeker_Number: double
  Impact_Seeker_List: double[5,d_raycount]
  Impact_Seeker_Total_Power: double

s_orientation = [0 -0.7796]
s_geo = [0; 0; 100]
s_fov = 0.1745329
s_aperture_diameter = 0.06
s_efficiency = 0.95
s_focal_distance = 0.002
s_ratio_gain = 28.64789
s_energy_threshold = 0.0001