% Simulink data dictionary Target_Sim_data.sldd

Target_bus = Simulink.Bus()
  Rot_matrix_target: double[3 3]
  Surface_center_global: double[3 6]
  Left_edge_center_global: double[3 6]
  Top_edge_center_global: double[3 6]

t_geo = [4500; 0; 1.15]
t_rotation = 0
t_velocity = [20; 0; 0]
t_size = [2.3 6.4 2.3]
t_reflect = repmat(0.4, 1, 6)